# Grasshopper definition builder_test.gh (Grasshopper 1.0.8)
# plug-ins: ComputeBuilder

change = Slider(7, range=0..20)
value_list = ValueList({"One": 1, "Two": 2, "Three": 2² - 1, "Four": Sqrt(16), "FIVE": 55555, "FUFU": 103344, "FIFI": Hallo}, selected="One")
get_integer = GetInteger(AtLeast=1, AtMost=1, Maximum=2147483647, Minimum=-2147483648, TreeAccess=False)
num = GetNumber(change, AtLeast=1, AtMost=1, Maximum=100, Minimum=5, TreeAccess=False)
im_text = GetString("fgdffgdfg", AtLeast=1, AtMost=1, TreeAccess=False)
valuelisterin = GetValueList(value_list, AtLeast=1, AtMost=1, Immediate=True, TreeAccess=False)
sphere = Sphere(Base=PlaneXY(0, 0, 0), Radius=num)
multiplication = Multiplication(A=num, B=Slider(2, range=0..10))
ui_builder = UIBuilder(
    Enable=Toggle(True),
    Refresh=Button(),
    OpenPreview=Toggle(True),
    Schema="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",
    SessionId="P0OAkp5x",
    Values="{\"8426f660-a18e-44bf-8529-89e5a32fd753\":\"One\"}")  # -> SessionID, Info, Schema
panel = Panel(valuelisterin)
unit_x = UnitX(Factor=multiplication)
panel_2 = Panel(num)
panel_3 = Panel(im_text)
number = Number(num)
linear_array = LinearArray(Geometry=sphere, Direction=unit_x, Count="40")  # -> Geometry, Transform
schema = ContextPrint()
addition = Addition(A=number, B=Slider(100, range=0..1000))
texterop = ContextPrint(ThisIsTheMainPut=addition)
three_material = ThreeMaterial(Color=RGB(255, 255, 255), Metalness=0, Roughness=0.5, Opacity=1, Transparent=False)
display = Display(Geo=linear_array.Geometry, ThreeMaterial=three_material)
name_that_should_not_be_named = ContextBake(OutPutName=display)
